# Dynamo graph CreateWallsWithExteriorOutline.dyn "01_CreateWallsWithExteriorOutline" (Dynamo 2.6.1.8786)
# packages: archi-lab.net 2020.23.5, Clockwork for Dynamo 2.x 2.3.0

# group: Model line type
wall_line_style = LineStyleUi("Wall - Exterior 1")  # graph input

# group: Get model lines
name = Element.Name(element=wall_line_style)
select_model_lines_by_style = Custom[Select Model Lines by Style](styleName=name)  # package archi-lab.net; This node will select all model lines in the revit project by a line style name.

# group: Level of 'Exterior Wall' model lines
level_of_model_lines = Levels("Caretaker T.O.S.")  # graph input
name_2 = Level.Name(level=level_of_model_lines)

# group: Filter for model lines by Level
parameters = Element.Parameters(element=select_model_lines_by_style)
code_block = CodeBlock { 11; }
getItemAtIndex = List.GetItemAtIndex(list=parameters@L2, index=code_block)
string_from_object = FromObject(obj=getItemAtIndex)
contains = String.Contains(str=string_from_object, searchFor=name_2)
filterByBoolMask = List.FilterByBoolMask(list=select_model_lines_by_style, mask=contains)

# group: Wall type
wall_type = WallTypes("Generic - 6\"")  # graph input

# group: Set wall placement centerline
curve = CurveElement.Curve(curveElement=filterByBoolMask.in)
byJoinedCurves = PolyCurve.ByJoinedCurves(curves=curve)
width = WallType.Width(wallType=wall_type)
code_block_2 = CodeBlock(wallWidth=width) { wallWidth; -wallWidth/2; false; }
offset = PolyCurve.Offset(polyCurve=byJoinedCurves, signedDistance=code_block_2.out1, extendCircular=code_block_2.out2)
byJoinedCurves_2 = PolyCurve.ByJoinedCurves(curves=offset)
curves = PolyCurve.Curves(polyCurve=byJoinedCurves_2)

# group: Draw model line to troubleshoot wall placement
byCurve = ModelCurve.ByCurve(curve=curves)  # frozen

# group: Top of wall
level_of_top_of_wall = Levels("Caretaker First Floor")  # graph input

byCurveAndLevels = Wall.ByCurveAndLevels(curve=curves, startLevel=level_of_model_lines, endLevel=level_of_top_of_wall, wallType=wall_type)
code_block_3 = CodeBlock { "Top Constraint"; }
setParameterByName = Element.SetParameterByName(element=byCurveAndLevels, parameterName=code_block_3, value=level_of_top_of_wall)

# group: Flip wall might help fix wall orientation.
flip = Custom[Wall.Flip](wall=setParameterByName)  # frozen; package Clockwork for Dynamo 2.x; Flips the orientation of a given wall - DO ***NOT*** USE IN AUTOMATIC MODE
