# Dynamo graph Elem_selection_length.dyn "ДЛИНА_Elem_SELECT на АВ_PS" (Dynamo 2.0.3.8810)

# group: Исходные данные
n1_пояснения = StringInput("Выделить элементы на АВ.")  # "1.Пояснения:"; graph input
n2_пояснения = StringInput("Наличие параметра \"Содержит NamePar\".")  # "2.Пояснения:"; graph input
n3_пояснения = StringInput("Если выделение изменили, то RUN")  # "3.Пояснения:"; graph input
desc = StringInput("""автор: sashtet@yandex.ru "Одна кнопка" 
Dynamo 2.0.3.
Ноды:Python Script
Пакеты:-нет 
Запускать в Player,Dynamo,Dyno 
Назначение: 
=>Получить выделенные на АВ элементы 
=>Сумма значения параметра NamePar 
Type Duble or Int ,
к примеру "Длина " 

OUT1=>Длина Сумма,метр 
OUT2=>Result 
OUT3=>Elems Содержит NamePar 
OUT4=>All Elems.Name""")  # graph input
RUN = BoolSelector(true)  # graph input
# note: Получить выделенные на АВ элементы
python_script = Python(IN[0]=RUN)
# ---------- python_script.python (25 lines) ----------
'Onuchin Alexsander sashtet@yandex.ru '
'Спасибо Хасану Мамаеву за алгоритм выбора элементов выделенных на активном виде (АВ)'
'Назначение:Получить выделенные на АВ элементы'
import clr
clr.AddReference('ProtoGeometry')
from Autodesk.DesignScript.Geometry import *
clr.AddReference('RevitAPI')
from Autodesk.Revit.DB import *
clr.AddReference("RevitNodes")
import Revit
clr.ImportExtensions(Revit.Elements)
clr.AddReference("RevitServices")
import RevitServices
from RevitServices.Persistence import DocumentManager
from RevitServices.Transactions import TransactionManager
doc = DocumentManager.Instance.CurrentDBDocument
uidoc = DocumentManager.Instance.CurrentUIApplication.ActiveUIDocument
ids = uidoc.Selection.GetElementIds()#Выделенные элементы ID Type=>ElementId
idd = [str(i) for i in ids]#Сохранить как string для элементов в списке ids

if isinstance(idd, list) == True:
	elems = [doc.GetElement(ElementId(int(i))) for i in idd]
else:
	elems = doc.GetElement(ElementId(int(idd)))
OUT = elems
# ----------------------------------------
namePar = StringInput("Длина")  # graph input
code_block = CodeBlock(ell=python_script) { ell; }

# group: Обработка параметра
code_block_2 = CodeBlock(ell=python_script) { ell; }
parameters = Element.Parameters(element=code_block_2)
name = Parameter.Name(parameter=parameters)
contains = String.Contains(str=name, searchFor=namePar)
filterByBoolMask = List.FilterByBoolMask(list=parameters, mask=contains)
flatten = List.Flatten(list=filterByBoolMask.in)
value = Parameter.Value(parameter=flatten)
sum = Math.Sum(values=value)
code_block_3 = CodeBlock(l=sum) { L=l/1000; }
code_block_4 = CodeBlock { 3; }
round = Math.Round(number=code_block_3, digits=code_block_4)
code_block_5 = CodeBlock(out1=round) { out1; }
code_block_6 = CodeBlock(ell=code_block_2) { ell.Name; }
code_block_7 = CodeBlock(out4=code_block_6) { out4; }

# group: Сортировка элементов по наличию параметра
allFalse = List.AllFalse(list=contains@L2)
filterByBoolMask_2 = List.FilterByBoolMask(list=code_block, mask=allFalse)
code_block_8 = CodeBlock(w=filterByBoolMask_2.in) { w.Name; }
if_emply = Python(IN[0]=code_block_8)
# ---------- if_emply.python (10 lines) ----------
# Включить поддержку Python и загрузить библиотеку DesignScript
import clr
clr.AddReference('ProtoGeometry')
from Autodesk.DesignScript.Geometry import *

# Введенные в этом узле данные сохраняется в виде списка в переменных IN.
lst = IN[0]
if len(lst)==0  : lst[:0]='OUT2 '+u'\u2B50'*10,"ВСЕ ЭЛЕМЕНТЫ ПОСЧИТАНЫ"
else : lst[:0]='OUT2 '+u'\u27F1'*14,"ЭЛЕМЕНТЫ НЕ ИМЕЮТ ПАРАМЕТРА:"
OUT=lst
# ----------------------------------------
code_block_9 = CodeBlock(w=filterByBoolMask_2.out) { w.Name; }
if_emply_2 = Python(IN[0]=code_block_9)
# ---------- if_emply_2.python (10 lines) ----------
# Включить поддержку Python и загрузить библиотеку DesignScript
import clr
clr.AddReference('ProtoGeometry')
from Autodesk.DesignScript.Geometry import *

# Введенные в этом узле данные сохраняется в виде списка в переменных IN.
lst = IN[0]
if len(lst)==0  : lst[:0]=["ЭЛЕМЕНТЫ НЕ ИМЕЮТ ПАРАМЕТРА"] 
else : lst[:0]='OUT3 '+u'\u2B50'*10,"ЭЛЕМЕНТЫ С ПАРАМЕТРОМ:"
OUT=lst
# ----------------------------------------
code_block_10 = CodeBlock(out2=if_emply, out3=if_emply_2) { out2; out3; }
name_2 = FamilyType.Name()  # unwired: familyType
sortByFunction = List.SortByFunction(list=code_block_10.out2, func=name_2)
uniqueItems = List.UniqueItems(list=sortByFunction)
name_3 = FamilyType.Name()  # unwired: familyType
sortByFunction_2 = List.SortByFunction(list=code_block_10.out3, func=name_3)
uniqueItems_2 = List.UniqueItems(list=sortByFunction_2)

# group: Вывод
# note: OUT
code_block_11 = CodeBlock(out1=code_block_5, out2=uniqueItems, out3=uniqueItems_2, out4=code_block_7) { out1; out2; out3; out4; }

# group: Вывод
# note: OUT
code_block_12 = CodeBlock(out1=code_block_11.out1, out2=code_block_11.out2, out3=code_block_11.out3, out4=code_block_11.out4) { out1; out2; out3; out4; }
code_block_13 = CodeBlock(out1=code_block_12.out1, out2=code_block_12.out2, out3=code_block_12.out3, out4=code_block_12.out4) { out1; out2; out3; out4; }
# note: OUT1
длина_метр = Watch(code_block_13.out1)  # graph output
# note: OUT2
result = Watch(code_block_13.out2)  # graph output
# note: OUT3
elems_содержит_namepar = Watch(code_block_13.out3)  # graph output
# note: OUT4
all_elems_name = Watch(code_block_13.out4)  # graph output
