# Dynamo graph GP_Voids_Levels_Input_Value.dyn (Dynamo 2.6.1.8786)

code_block = CodeBlock { "Rectangular Horizontal"; }
byName = FamilyType.ByName(name=code_block)
all_elements_of_family_type = ElementsOfFamilyType(Family_Type=byName)
code_block_2 = CodeBlock { "GP_ОТВ_Отметка низа"; }
getLocation = Element.GetLocation(element=all_elements_of_family_type)
Z = Point.Z(point=getLocation)
code_block_3 = CodeBlock { 0; }
round = Math.Round(number=Z, digits=code_block_3)
code_block_4 = CodeBlock { "MC Height Instance"; }
getParameterValueByName = Element.GetParameterValueByName(element=all_elements_of_family_type, parameterName=code_block_4)
code_block_5 = CodeBlock { 2; }
div = getParameterValueByName / code_block_5
sub = round - div
code_block_6 = CodeBlock { 1000; }
divRem = Math.DivRem(dividend=sub, divisor=code_block_6)
code_block_7 = CodeBlock { 50; }
div_2 = divRem / code_block_7
round_2 = Math.Round(number=div_2)
code_block_8 = CodeBlock { 50; }
mul = round_2 * code_block_8
code_block_9 = CodeBlock { 1000; }
div_3 = mul / code_block_9
code_block_10 = CodeBlock { 1000; }
div_4 = sub / code_block_10
code_block_11 = CodeBlock { 1000; }
divRem_2 = Math.DivRem(dividend=div_4, divisor=code_block_11)
add = div_3 + divRem_2
string_from_object = FromObject(obj=add)
code_block_12 = CodeBlock { -1; }
code_block_13 = CodeBlock { -3; }
remove = String.Remove(str=string_from_object, startIndex=code_block_12, count=code_block_13)
setParameterByName = Element.SetParameterByName(element=all_elements_of_family_type, parameterName=code_block_2, value=remove)
floor = Math.Floor()  # unwired: number
concat = String.Concat()  # unwired: string0
