# Dynamo graph LinkInstance.GetProperty_publish_13.dyn "Default" (Dynamo 1.3.4.6666)

# note: Инструкция:
# Запустить скрипт и выбрать элемент связанной модели. Скрипт позволит выбрать элементы только из связанных файлов.
# В результате появится диалоговое окно, в котором будет выданы следующие данные:
# <id элемента> (Имя категории), <Имя связанного файла>;
# Возможна ситуация, когда будут выданы две и более строчек информации об элементы. В данном случае следует выбрать необходимые параметры исходя из имени документа.
boolean = BoolSelector(true)
python_script = Python(IN[0]=boolean)
# ---------- python_script.python (51 lines) ----------
import clr
from System.Collections.Generic import *

clr.AddReference("RevitAPI")
import Autodesk
from Autodesk.Revit.DB import *

clr.AddReference("RevitAPIUI")
from Autodesk.Revit.UI import *

clr.AddReference("RevitServices")
import RevitServices
from RevitServices.Persistence import DocumentManager
from RevitServices.Transactions import TransactionManager

doc = DocumentManager.Instance.CurrentDBDocument
uiapp = DocumentManager.Instance.CurrentUIApplication
app = uiapp.Application
uidoc=DocumentManager.Instance.CurrentUIApplication.ActiveUIDocument

ObjType = Autodesk.Revit.UI.Selection.ObjectType
StructType = Autodesk.Revit.DB.Structure.StructuralType.NonStructural

linkInstances = FilteredElementCollector(doc).OfClass(RevitLinkInstance)
linkDocument = [i.GetLinkDocument() for i in linkInstances]

elem_link = uidoc.Selection.PickObject(ObjType.LinkedElement, "Выберите элемент связанного файла")#.LinkedElementId

_debug =[]
host = []
res = {}
el = None

for link in linkDocument:
	try:
		el = link.GetElement(elem_link.LinkedElementId)
	except: pass
	if el != None:
		res[el.Document.Title] = el

res_string = ''
for key in res:
    res_string += 'Id {1} ({0}), {2}; \n'.format(res[key].Category.Name ,res[key].Id, key)

if len(host) == 0:
    TaskDialog.Show('Выбранный элемент',
                    res_string)



OUT = host, elem_link.CreateReferenceInLink()
# ----------------------------------------
