# Dynamo graph PinAllLinks.dyn "BIM1_PinAllLinks" (Dynamo 2.0.2.6826)

# note: MONITORING
# note: BACKEND
# note: USER INTERFACE

# group: BIMOne
# note: DEPENDANCIES
# CODE
# note: EDITOR
# Jean-Marc Couffin - May 2019 - v1.1
# note: CREATOR
# Jean-Marc Couffin - May 2018 - v1.0
# Dynamo 2.0
# note: Copyright:
# This script is provided "as-is" under MIT License
# note: Created by BIMOne
# Pin all links

# group: PACKAGE NAME
# note: Always name the specific package to facilitate debugging and deployment
# Exploding a package helps deployment to clients
# Example:
# Clockworks 1.5.5

# group: ACTION - DATA
# note: part of the script that affect data:
# Examples:
# ACTION - DATA - get parameter name from txt file

# group: MONITORING - description
# note: ckeck the integrity and consistency of data or geometry affected
# Examples:
# number of rooms matches number of parameters changed

# group: ACTION - GEOMETRY
# note: part of the script that affect  geometry:
# Examples:
# ACTION - GEOMETRY - translate geometry to new location

# group: UI
# note: User interface for the script: describe what the UI will do
# Example:
# UI - get shared parameter file path

# group: CONSTRAINT
# note: Fixed input that should not be set as inputs available through the dynamo player

# group: INPUT
# note: input by user that should be set as input for the dynamo player

# group: ACTION - DATA Check revit language
# note: INPUT
looks_up_for_some_french_to = Python()  # "Looks up for some french to design the interface"; unwired: IN[0]
# ---------- looks_up_for_some_french_to.python (16 lines) ----------
# BIM One Inc. - Jean-Marc Couffin - 2018

import clr
clr.AddReference('RevitServices')
from RevitServices.Persistence import DocumentManager

doc = DocumentManager.Instance.CurrentDBDocument

lang = str(doc.Application.Language)

if lang =="French":
	x = True
else:
	x = False
	
OUT = x
# ----------------------------------------

# group: Français
string = StringInput("Liste des fichiers liés épinglés")
string_2 = StringInput(" fichier(s) lié(s) épinglé(s): ")
list_create = List.Create(item0=string, item1=string_2)

# group: English
string_3 = StringInput("List of pinned linked files")
string_4 = StringInput(" linked files pinned: ")
list_create_2 = List.Create(item0=string_3, item1=string_4)

if_ = If(test=looks_up_for_some_french_to, true=list_create, false=list_create_2)
code_block = CodeBlock(x=if_) { x[0]; x[1]; }

# group: INPUT True will pin Revit link instances
boolean = BoolSelector(true)

# group: ACTION - DATA Pin link instances
python_script = Python(IN[0]=boolean)
# ---------- python_script.python (36 lines) ----------
import clr

clr.AddReference("RevitServices")
import RevitServices
from RevitServices.Persistence import DocumentManager
from RevitServices.Transactions import TransactionManager
doc = DocumentManager.Instance.CurrentDBDocument

clr.AddReference("RevitNodes")
import Revit
clr.ImportExtensions(Revit.Elements)
clr.ImportExtensions(Revit.GeometryConversion)

clr.AddReference("RevitAPI")
from Autodesk.Revit.DB import *

# Instantiate current document
doc = DocumentManager.Instance.CurrentDBDocument
# Collect link documents from current document
link_docs = FilteredElementCollector(doc).OfClass(RevitLinkInstance)
pinStatus = IN[0]
# OUT Variables...
outList = []

# Main Body...
TransactionManager.Instance.EnsureInTransaction(doc)
for e in link_docs:
    try:
# Set pin status 0 unpinned, 1 pinned
        e.Pinned = pinStatus
        outList.append(e.Name.split(':')[0])
    except Exception, ex:
        outList.append(ex.message)
TransactionManager.Instance.TransactionTaskDone()

OUT = str('\n'.join(outList)), len(outList)
# ----------------------------------------

code_block_2 = CodeBlock(x=python_script) { x[0]; x[1]; }

# group: MONITORING Count how many were processed
python_script_2 = Python(IN[0]=code_block.out0, IN[1]=code_block_2.out1, IN[2]=code_block.out1, IN[3]=code_block_2.out0)
# ---------- python_script_2.python (13 lines) ----------
# BIM One Inc. - Jean-Marc Couffin - 2019

import clr
clr.AddReference('RevitAPIUI')
from Autodesk.Revit.UI import TaskDialog


Title = IN[0]
TotalCount = str(IN[1])
Processed = IN[2]
Deleted = IN[3]

TaskDialog.Show( Title, TotalCount + ' ' + Processed + "\n" + "\n" + Deleted)
# ----------------------------------------
