# Dynamo graph area.dyn "Area" (Dynamo 2.0.3.8810)

# group: Дано
select_model_elements = DSModelElementsSelection()  # 4 picked in the model
string = StringInput("Комментарии")

# group: Контур
filter = Python(IN[0]=select_model_elements)
# ---------- filter.python (14 lines) ----------
# Включить поддержку Python и загрузить библиотеку DesignScript
import clr
clr.AddReference('ProtoGeometry')
from Autodesk.DesignScript.Geometry import *

els=IN[0]
elem=[]
if els.GetType().Name=="List":
	for i in els:
		if UnwrapElement(i).GetType().Name=="AreaReinforcement":
			elem.append(i)
else:
	elem=els
OUT = elem
# ----------------------------------------
geometry = Element.Geometry(element=filter)
count_2 = Python(IN[0]=geometry)
# ---------- count_2.python (17 lines) ----------
# Включить поддержку Python и загрузить библиотеку DesignScript
import clr
clr.AddReference('ProtoGeometry')
from Autodesk.DesignScript.Geometry import *

els=IN[0]
kol=[]

if els[0].GetType().Name=="Line" or els[0].GetType().Name=="Arc":
	n=els.Count/2
	kol.append(n)
else:
	for i in els:
		n=i.Count/2
		kol.append(n)
	
OUT = kol
# ----------------------------------------
takeItems = List.TakeItems(list=geometry@L2, amount=count_2@L1)
ZAxis = Vector.ZAxis()
extrude = Curve.Extrude(curve=takeItems, direction=ZAxis)
byJoinedSurfaces = PolySurface.ByJoinedSurfaces(surfaces=extrude)
unconnectedBoundaries = PolySurface.UnconnectedBoundaries(polySurface=byJoinedSurfaces)
code_block = CodeBlock { 2; }
takeEveryNthItem = List.TakeEveryNthItem(list=unconnectedBoundaries@L2, n=code_block)

# group: Расчет
byPatch = Surface.ByPatch(closedCurve=takeEveryNthItem)
area = Surface.Area(surface=byPatch)
maximumItem = List.MaximumItem(list=area)
code_block_2 = CodeBlock(a=area, b=maximumItem) { a==b; }
filterByBoolMask = List.FilterByBoolMask(list=area, mask=code_block_2)
sum = Math.Sum(values=filterByBoolMask.out)
code_block_3 = CodeBlock(a=maximumItem, b=sum) { a-b; }
code_block_4 = CodeBlock(area=code_block_3) { area/1000000+" м²"; }

# group: Итог
setParameterByName = Element.SetParameterByName(element=select_model_elements, parameterName=string, value=code_block_4)
