# Dynamo graph delete_filters_from_view.dyn "VM_Удаление фильтров с вида" (Dynamo 2.0.3.8810)

element_types = ElementTypes(index=127)
all_elements_of_type = ElementsOfType(element_type=element_types)
name = Element.Name(element=all_elements_of_type)
префикс_для_имени_фильтра = StringInput("VM_Цвет для системы")  # graph input
contains = String.Contains(str=name, searchFor=префикс_для_имени_фильтра)
filterByBoolMask = List.FilterByBoolMask(list=all_elements_of_type, mask=contains)
python_script = Python(IN[0]=filterByBoolMask.in)
# ---------- python_script.python (21 lines) ----------
import clr
clr.AddReference("RevitServices")
import RevitServices
from RevitServices.Persistence import DocumentManager
from RevitServices.Transactions import TransactionManager
clr.AddReference("RevitNodes")

doc = DocumentManager.Instance.CurrentDBDocument
	
elementstd = UnwrapElement (IN[0])
deleted = []
	
TransactionManager.Instance.EnsureInTransaction(doc)
	
for elements in elementstd:
	doc.Delete(elements.Id)
	deleted.append(elements)
		
	TransactionManager.Instance.TransactionTaskDone()
	
	OUT = IN[0]
# ----------------------------------------
