# Dynamo graph filter_change.dyn "VM_Переносчик фильтров" (Dynamo 2.0.3.8810)

# group: Виды, на которые копируем фильтры
element_types = ElementTypes(index=329)
all_elements_of_type = ElementsOfType(element_type=element_types)
name = Element.Name(element=all_elements_of_type)
текст_в_именах_видов_к_которым = StringInput("О_ОВ_Схема")  # "Текст в именах видов, к которым добавляем фильтры"; graph input
contains = String.Contains(str=name, searchFor=текст_в_именах_видов_к_которым)
filterByBoolMask = List.FilterByBoolMask(list=all_elements_of_type, mask=contains)
transpose = List.Transpose(lists=filterByBoolMask.in@L1)

вид_с_которого_берём_фильтры = Views(index=22)  # graph input

# group: Отбираем фильтры с префиксом
filters = View.Filters(view=вид_с_которого_берём_фильтры)
name_2 = Element.Name(element=filters)
префикс_имени_фильтра = StringInput("VM_Цвет для системы")  # graph input
contains_2 = String.Contains(str=name_2, searchFor=префикс_имени_фильтра)
filterByBoolMask_2 = List.FilterByBoolMask(list=filters, mask=contains_2)

# note: Получаем настройки цвета для фильтра
filterOverrides = View.FilterOverrides(view=вид_с_которого_берём_фильтры, parameterFilter=filterByBoolMask_2.in)

# group: Назначаем фильтры и настройки цвета к видам
code_block = CodeBlock { 1; }
setFilterOverrides = View.SetFilterOverrides(view=transpose@L1, parameterFilter=filterByBoolMask_2.in, overrides=filterOverrides, hide=code_block)
