# Dynamo graph filter_duct_colour.dyn "VM_Фильтр с цветом воздуховодов" (Dynamo 2.0.3.8810)

# group: Виды, на которые копируем фильтры
element_types = ElementTypes(index=329)
all_elements_of_type = ElementsOfType(element_type=element_types)
name = Element.Name(element=all_elements_of_type)
текст_в_именах_видов_к_которым = StringInput("О_ОВ_Схемы")  # "Текст в именах видов, к которым добавляем фильтры"; graph input
contains = String.Contains(str=name, searchFor=текст_в_именах_видов_к_которым)
filterByBoolMask = List.FilterByBoolMask(list=all_elements_of_type, mask=contains)
transpose = List.Transpose(lists=filterByBoolMask.in@L1)

префикс_для_имени_фильтра = StringInput("VM_Цвет")  # graph input

# group: Выбираем все элементы вентиляции из всех категорий
code_block = CodeBlock()
# ---------- code_block.designscript (8 lines) ----------
["OST_DuctTerminal",
"OST_DuctAccessory",
"OST_DuctFitting",
"OST_DuctInsulations",
"OST_DuctLinings",
"OST_DuctCurves",
"OST_FlexDuctCurves",
"OST_MechanicalEquipment"];
# ----------------------------------------
byName = Category.ByName(name=code_block)
all_elements_of_category = ElementsOfCategory(Category=byName)
flatten = List.Flatten(list=all_elements_of_category)

параметр_для_фильтрации = StringInput("Имя системы")  # graph input

# group: Список имён систем
getParameterValueByName = Element.GetParameterValueByName(element=flatten, parameterName=параметр_для_фильтрации)
uniqueItems = List.UniqueItems(list=getParameterValueByName)
transpose_2 = List.Transpose(lists=uniqueItems@L1)
count = List.Count(list=uniqueItems)

# group: Выбор правила для фильтра
select_rule_type = RuleTypes(index=3)
parameterByName = Parameter.ParameterByName(element=flatten, name=параметр_для_фильтрации)
byRuleType = Revit.Filter.FilterRule.ByRuleType(type=select_rule_type, value=transpose_2, parameter=parameterByName)

# group: Создаём фильтры по количеству систем
code_block_2 = CodeBlock(A=префикс_для_имени_фильтра, B=transpose_2) { A + " " + B; }
byRules = Revit.Filter.ParameterFilterElement.ByRules(name=code_block_2, categories=byName, rules=byRuleType)
flatten_2 = List.Flatten(list=byRules)

# group: Создаём рандомные цвета по количеству систем
randomList = Math.RandomList(amount=count)
code_block_3 = CodeBlock { 255; }
mul = randomList * code_block_3
randomList_2 = Math.RandomList(amount=count)
code_block_4 = CodeBlock { 255; }
mul_2 = randomList_2 * code_block_4
randomList_3 = Math.RandomList(amount=count)
code_block_5 = CodeBlock { 255; }
mul_3 = randomList_3 * code_block_5
byARGB = Color.ByARGB(r=mul, g=mul_2, b=mul_3)

# group: Настройки переопределения видимости элементов
менять_заливку = BoolSelector(true)  # graph input
выбрать_тип_заливки = FillPatterns(index=0)  # graph input
fill_patterns = FillPatterns()  # nothing selected
if_ = If(test=менять_заливку, true=выбрать_тип_заливки, false=fill_patterns)
менять_тип_линий = BoolSelector(false)  # graph input
выбрать_тип_линий = LinePatterns(index=10)  # graph input
line_patterns = LinePatterns()  # nothing selected
if_2 = If(test=менять_тип_линий, true=выбрать_тип_линий, false=line_patterns)
менять_толщину_линий = BoolSelector(false)  # graph input
указать_толщину_линий = DoubleInput(3)  # graph input
code_block_6 = CodeBlock { -1; }
if_3 = If(test=менять_толщину_линий, true=указать_толщину_линий, false=code_block_6)
byProperties = Revit.Filter.OverrideGraphicSettings.ByProperties(projectionFillColor=byARGB, projectionFillPattern=if_, projectionLinePattern=if_2, projectionLineWeight=if_3)

# group: Назначение фильтров на вид
code_block_7 = CodeBlock { 1; }
setFilterOverrides = View.SetFilterOverrides(view=transpose@L1, parameterFilter=flatten_2, overrides=byProperties, hide=code_block_7)

# group: Какие фильтры добавились к виду
filters = View.Filters(view=transpose)
name_2 = Element.Name(element=filters)
добавленные_фильтры = Watch(name_2)  # graph output
