# Dynamo graph name_hvac_systems.dyn "VM_Назначение имён систем" (Dynamo 2.0.3.8810)

categories = Categories(index=491)
all_elements_of_category = ElementsOfCategory(Category=categories)
name = Element.Name(element=all_elements_of_category)

# group: Префиксы
# note: Этот префикс Ревит сам добавляет всем именам систем, которые создаёт, если у типа системы не заполнен параметр «Сокращение». Этот текст общий для всех систем, независимо от типа. Его надо отсечь, чтобы он не мешал
префикс_имени_системы_по = StringInput("Механизмы ADSK_")  # "Префикс имени системы по умолчанию"; graph input
префикс_рециркуляции = StringInput("Р")  # graph input
префикс_системы_подпора = StringInput("ПД")  # graph input
префикс_системы_дымоудаления = StringInput("ВД")  # graph input
префикс_вытяжной_системы = StringInput("В")  # graph input
# note: Если нужно формировать имена систем с пробелом перед числом, то добавьте пробел после обозначения системы. По умолчанию пробела нет
префикс_приточной_системы = StringInput("П")  # graph input

split = String.Split(str=name, separater0=префикс_имени_системы_по)
firstItem = List.FirstItem(list=split@L2)
code_block = CodeBlock { "Приточный"; "Отработанный"; "Дымоудаление"; "Подпор"; "Рециркул"; }
contains = String.Contains(str=firstItem, searchFor=code_block.out4)
Р = List.FilterByBoolMask(list=all_elements_of_category, mask=contains)
code_block_2 = CodeBlock { "Имя системы"; }
name_2 = Element.Name(element=Р.in)
code_block_3 = CodeBlock { " "; }
split_2 = String.Split(str=name_2, separater0=code_block_3)
lastItem = List.LastItem(list=split_2@L2)
code_block_4 = CodeBlock(A=префикс_рециркуляции, B=lastItem) { A+B; }
setParameterByName = Element.SetParameterByName(element=Р.in, parameterName=code_block_2, value=code_block_4)
contains_2 = String.Contains(str=firstItem, searchFor=code_block.out3)
ПД = List.FilterByBoolMask(list=all_elements_of_category, mask=contains_2)
name_3 = Element.Name(element=ПД.in)
code_block_5 = CodeBlock { " "; }
split_3 = String.Split(str=name_3, separater0=code_block_5)
lastItem_2 = List.LastItem(list=split_3@L2)
code_block_6 = CodeBlock(A=префикс_системы_подпора, B=lastItem_2) { A+B; }
setParameterByName_2 = Element.SetParameterByName(element=ПД.in, parameterName=code_block_2, value=code_block_6)
contains_3 = String.Contains(str=firstItem, searchFor=code_block.out2)
ДУ = List.FilterByBoolMask(list=all_elements_of_category, mask=contains_3)
name_4 = Element.Name(element=ДУ.in)
code_block_7 = CodeBlock { " "; }
split_4 = String.Split(str=name_4, separater0=code_block_7)
lastItem_3 = List.LastItem(list=split_4@L2)
code_block_8 = CodeBlock(A=префикс_системы_дымоудаления, B=lastItem_3) { A+B; }
setParameterByName_3 = Element.SetParameterByName(element=ДУ.in, parameterName=code_block_2, value=code_block_8)
contains_4 = String.Contains(str=firstItem, searchFor=code_block.out1)
вытяжка = List.FilterByBoolMask(list=all_elements_of_category, mask=contains_4)
name_5 = Element.Name(element=вытяжка.in)
code_block_9 = CodeBlock { " "; }
split_5 = String.Split(str=name_5, separater0=code_block_9)
lastItem_4 = List.LastItem(list=split_5@L2)
code_block_10 = CodeBlock(A=префикс_вытяжной_системы, B=lastItem_4) { A+B; }
setParameterByName_4 = Element.SetParameterByName(element=вытяжка.in, parameterName=code_block_2, value=code_block_10)
contains_5 = String.Contains(str=firstItem, searchFor=code_block.out0)
приток = List.FilterByBoolMask(list=all_elements_of_category, mask=contains_5)
name_6 = Element.Name(element=приток.in)
code_block_11 = CodeBlock { " "; }
split_6 = String.Split(str=name_6, separater0=code_block_11)
lastItem_5 = List.LastItem(list=split_6@L2)
code_block_12 = CodeBlock(A=префикс_приточной_системы, B=lastItem_5) { A+B; }
setParameterByName_5 = Element.SetParameterByName(element=приток.in, parameterName=code_block_2, value=code_block_12)
