# Dynamo graph set_active_workset.dyn "BIM1_SetActiveWorkset" (Dynamo 2.3.0.5885)

# note: BACKEND
# note: MONITORING
# note: USER INTERFACE

# group: BIMOne
# note: DEPENDANCIES
# CODE
# note: EDITOR
# note: CREATOR
# Jean-Marc Couffin - Mars 2020 - v1.0
# Dynamo 2.0
# note: Copyright:
# This script is provided "as-is" under MIT License
# note: Created by BIMOne
# Set active workset fro revit selection

# group: PACKAGE NAME
# note: Always name the specific package to facilitate debugging and deployment
# Exploding a package helps deployment to clients
# Example:
# Clockworks 1.5.5

# group: MONITORING - description
# note: ckeck the integrity and consistency of data or geometry affected
# Examples:
# number of rooms matches number of parameters changed

# group: ACTION - GEOMETRY
# note: part of the script that affect  geometry:
# Examples:
# ACTION - GEOMETRY - translate geometry to new location

# group: ACTION - DATA
# note: part of the script that affect data:
# Examples:
# ACTION - DATA - get parameter name from txt file

# group: UI
# note: User interface for the script: describe what the UI will do
# Example:
# UI - get shared parameter file path

# group: CONSTRAINT
# note: Fixed input that should not be set as inputs available through the dynamo player

# group: INPUT
# note: input by user that should be set as input for the dynamo player

# group: INPUT Switch to rerun the script
# note: INPUT
boolean = BoolSelector(true)

# group: ACTION - GEOMETRY
python_script = Python(IN[0]=boolean)
# ---------- python_script.python (51 lines) ----------
import clr
clr.AddReference('ProtoGeometry')
from Autodesk.DesignScript.Geometry import *

clr.AddReference("RevitNodes")
import Revit
clr.ImportExtensions(Revit.Elements)

clr.ImportExtensions(Revit.GeometryConversion)

clr.AddReference("RevitServices")
import RevitServices
from RevitServices.Persistence import DocumentManager
from RevitServices.Transactions import TransactionManager
from System.Collections.Generic import *

clr.AddReference("RevitAPI")
import Autodesk
from Autodesk.Revit.DB import *

doc = DocumentManager.Instance.CurrentDBDocument
uiapp = DocumentManager.Instance.CurrentUIApplication
app = uiapp.Application
uidoc=DocumentManager.Instance.CurrentUIApplication.ActiveUIDocument

select = []
elements = []
select = uidoc.Selection.GetElementIds()
inter = []
results = []

for i in select:
		elements.append(doc.GetElement(i).ToDSType(True))

ele = UnwrapElement(elements)
		
for i in ele:
		inter.append(doc.GetWorksetTable().GetWorkset(i.WorksetId).Id)
	
#Set active WS
TransactionManager.Instance.EnsureInTransaction(doc)

for i in inter:
	doc.GetWorksetTable().SetActiveWorksetId(i)
	
TransactionManager.Instance.TransactionTaskDone()

w = doc.GetWorksetTable().GetActiveWorksetId()
results.append(doc.GetWorksetTable().GetWorkset(w).Name)

OUT = results
# ----------------------------------------
