# Dynamo graph sheets_sets.dyn (Dynamo 1.3.3.4111)

# note: ВСЁ ОСТАЛЬНОЕ

# group: ЭЛЕМЕНТЫ УПРАВЛЕНИЯ
# note: ПЕРЕМЕННЫЕ ЗНАЧЕНИЯ
# note: ЭЛЕМЕНТЫ УПРАВЛЕНИЯ

# group: ПОЛУЧАЕМ ДАННЫЕ ИЗ РЕВИТ
# note: ПОЛУЧАЕМ ДАННЫЕ ИЗ РЕВИТ

# group: ПРОВЕРОЧНЫЕ НОДЫ
# note: ПРОВЕРОЧНЫЕ НОДЫ

# group: КЛЮЧЕВЫЕ МОМЕНТЫ РАБОТЫ
# note: ИТОГОВАЯ КОНСОЛИДАЦИЯ ДАННЫХ

# group: ИСПОЛНИТЕЛЬНЫЕ НОДЫ (фильтрование, подбор, списки и т.д.)
# note: ИСПОЛНИТЕЛЬНЫЕ НОДЫ
# note: НОДЫ РАБОТАЮЩИЕ С ДАННЫМИ

# group: ЗАПАСНЫЕ ВАРИАНТЫ, ДОПОЛНИТЕЛЬНЫЕ ОПЦИИ
# note: ЗАПАСНЫЕ
# note: ДОПОЛНИТЕЛЬНЫЕ. Градации серово по важности, темнее - важнее

# group: ПЕРЕДАЁМ ИНФОРМАЦИЮ В РЕВИТ
# note: ПЕРЕДАЁМ ИНФОРМАЦИЮ В РЕВИТ

# group: ПРИМЕЧАНИЯ ПО ЦВЕТОВОЙ ГРУППИРОВКЕ
# note: GUIDELINES

groupByFunction = GroupByFunction()  # unwired: arg0, arg1
categories = Categories("Sheets")
all_elements_of_category = ElementsOfCategory(categories)
forceChildrensEval = ForceChildrensEval(all_elements_of_category)
параметры_для_фильтрации = CodeBlock { /*1)*/"Альбом"; /*2)*/"Корпус"; "PP_Раздел"; }
getParameterValueByName = Element.GetParameterValueByName(element=forceChildrensEval, parameterName=параметры_для_фильтрации.out2)
раздел = StringInput("ВК2")
equals = Equals(getParameterValueByName, раздел)
filterByBoolMask = List.FilterByBoolMask(list=forceChildrensEval, mask=equals)
getParameterValueByName_2 = Element.GetParameterValueByName(element=filterByBoolMask.in, parameterName=параметры_для_фильтрации.out1)
equals_2 = Equals(getParameterValueByName_2)  # unwired: arg1
filterByBoolMask_2 = List.FilterByBoolMask(list=filterByBoolMask.in, mask=equals_2)
getParameterValueByName_3 = Element.GetParameterValueByName(element=filterByBoolMask_2.in, parameterName=параметры_для_фильтрации.out2)
equals_3 = Equals(getParameterValueByName_3, раздел)
filterByBoolMask_3 = List.FilterByBoolMask(list=forceChildrensEval, mask=equals_3)

# group: [SPRINGS] package
code_block = CodeBlock(views=filterByBoolMask.in) { views; }
code_block_2 = CodeBlock(setName=раздел) { setName; }
code_block_3 = CodeBlock { Overwrite:bool = true; }
byViewsName = Python(IN[0]=code_block, IN[1]=code_block_2, IN[2]=code_block_3)  # "Springs.ViewSet.ByViewsName"
# ---------- byViewsName.python (56 lines) ----------
#Copyright(c) 2015, Dimitar Venkov
# @5devene, dimitar.ven@gmail.com
#code inspired by Harry Mattison
#https://boostyourbim.wordpress.com

import clr

clr.AddReference("RevitServices")
import RevitServices
from RevitServices.Persistence import DocumentManager
from RevitServices.Transactions import TransactionManager
doc = DocumentManager.Instance.CurrentDBDocument

clr.AddReference("RevitAPI")
from Autodesk.Revit.DB import *

def tolist(obj1):
	if hasattr(obj1,"__iter__") : return obj1
	else : return [obj1]

def first(obj1):
	if hasattr(obj1,'__iter__') : return obj1[0]
	else : return obj1

views = UnwrapElement(tolist(IN[0]))
name1 = IN[1]
overwrite = IN[2]
vs_exists = None

fec = FilteredElementCollector(doc).OfClass(ViewSheetSet).GetElementIterator()
fec.Reset()
for f in fec:
	if f.Name == name1:
		vs_exists = f
		break
if vs_exists != None and overwrite:
	TransactionManager.Instance.EnsureInTransaction(doc)
	doc.Delete(vs_exists.Id)
	TransactionManager.Instance.TransactionTaskDone()
	vs_exists = None
elif vs_exists != None and not overwrite:
	OUT = "There's a ViewSet with the same name.\nSet Overwrite to true to continue."
if vs_exists == None:
	vs1 = ViewSet()
	for v in views: (vs1.Insert(v))
	printMan = doc.PrintManager
	printMan.PrintRange = PrintRange.Select
	viewSS = printMan.ViewSheetSetting
	try:
		TransactionManager.Instance.EnsureInTransaction(doc)
		viewSS.CurrentViewSheetSet.Views = vs1
		viewSS.SaveAs(name1)
		TransactionManager.Instance.TransactionTaskDone()
		OUT = "ViewSet created with %s views inside." %len(views)
	except:
		OUT = "The ViewSet could not be created"
# ----------------------------------------

code_block_4 = CodeBlock(Раздел=раздел) { "("+Альбом+")_("+Корпус+")_("+Раздел+")"; }  # unwired: Альбом, Корпус
